# Grasshopper definition CanopyStructure.gh (Grasshopper 1.0.7)
# plug-ins: LunchBox

srf = Surface(<surface referenced from the Rhino model>)
spacetruss_1 = SpaceTrussStructure1(Surface=srf, UDivisions=10, VDivisions=10, TrussDepth=expr("-x", Slider(4, range=0..10)))  # -> LinesA, LinesB, Web, Nodes
sph = Sphere(Base=spacetruss_1.Nodes, Radius=Slider(0.4, range=0..1))
pipe = Pipe(Curve=[spacetruss_1.LinesB, spacetruss_1.Web, spacetruss_1.LinesA], Radius=Slider(0.2, range=0..1), Caps=0)
