# Grasshopper definition Goods_Belt.gh (Grasshopper 1.0.7)

crv = Curve(<curve referenced from the Rhino model>)
Z = UnitZ(Factor=Slider(9, range=0..10))
move = Move(Geometry=crv, Motion=Z)  # -> Geometry, Transform
offset = OffsetCurve(Curve=move.Geometry, Distance=Slider(0.2, range=0..1), Corners=1)  # -> flatten(Curve)
offset_2 = OffsetCurve(Curve=move.Geometry, Distance=Slider(0.1, range=0..0.1), Corners=1)  # -> flatten(Curve)
offset_3 = OffsetCurve(Curve=offset, Distance=Slider(0.1, range=0..0.1), Corners=1)  # -> flatten(Curve)
loft = Loft(
    Curves=[offset, offset_3],
    Options={Adjust=False, Closed=False, LoftEnds=0, LoftSimp=0, LoftType=0, Rebuild=10, Refit=0.01})
loft_2 = Loft(
    Curves=[offset_2, move.Geometry],
    Options={Adjust=False, Closed=False, LoftEnds=0, LoftSimp=0, LoftType=0, Rebuild=10, Refit=0.01})
Z_2 = UnitZ(Factor=Slider(0.4, range=0..1))
Z_3 = UnitZ(Factor=1)
extr = Extrude(Base=loft, Direction=Z_2)
extr_2 = Extrude(Base=loft_2, Direction=Z_3)
