# Grasshopper definition Road Dash line.gh (Grasshopper 1.0.7)
# plug-ins: Pufferfish

crv = Curve(<curve referenced from the Rhino model>)
crv_2 = Curve(<curve referenced from the Rhino model>)
divlength = DivideLength(Curve=crv, Length=Slider(1, range=0..10))  # -> Points, Tangents, Parameters
divlength_2 = DivideLength(Curve=crv_2, Length=Slider(1, range=0..10))  # -> Points, Tangents, Parameters
pt = Point(divlength.Points)
pt_2 = Point(divlength_2.Points)
vec2pt = Vector2Pt(PointA=pt, PointB=pt_2, Unitize=False)  # -> Vector, Length
ln = Line(StartPoint=pt, EndPoint=pt_2)
eval = EvaluateCurve(Curve=crv, Parameter=Slider(0, range=0..0.1))  # -> Point, Tangent, Angle
multiplication = Multiplication(A=eval.Tangent, B=Slider(0.5, range=0..1))
extr = Extrude(Base=ln, Direction=multiplication)
Z = UnitZ(Factor=Slider(0.02, range=0..0.1))
extr_2 = Extrude(Base=extr, Direction=Z)

crv_3 = Curve([<curve referenced from the Rhino model> x10])
number_slider = Slider(0.2, range=0..1)
divdist = DivideDistance(Curve=crv_3, Distance=Slider(4.1, range=0..10))  # -> Points, Tangents, Parameters
crv_4 = Curve([<curve referenced from the Rhino model> x13])
neg = Negative(Value=number_slider)
multiplication_2 = Multiplication(A=divdist.Tangents, B=Slider(3, range=0..10))
dash = DashPattern(Curve=crv_3, Pattern=multiplication_2)  # -> Dashes, Gaps
offcrv = OffsetCurve(Curve=crv_4, Plane=PlaneXY(0, 0, 0), Distance=number_slider, BothSides=neg, Kinks=0, CapType=1)
number_slider_2 = Slider(0.2, range=0..1)
boundary = BoundarySurfaces(Edges=offcrv)
crv_5 = Curve(dash.Dashes)
neg_2 = Negative(Value=number_slider_2)
Z_2 = UnitZ(Factor=Slider(0.02, range=0..0.1))
offcrv_2 = OffsetCurve(Curve=crv_5, Plane=PlaneXY(0, 0, 0), Distance=number_slider_2, BothSides=neg_2, Kinks=0, CapType=1)
extr_3 = Extrude(Base=boundary, Direction=Z_2)
boundary_2 = BoundarySurfaces(Edges=offcrv_2)
Z_3 = UnitZ(Factor=Slider(0.02, range=0..0.1))
extr_4 = Extrude(Base=boundary_2, Direction=Z_3)
